# Dynamo graph elevacionEje_script.dyn (Dynamo 2.3.1.11775)
# packages: Data-Shapes 2022.2.96, Clockwork for Dynamo 2.x 2.3.0, Orchid 200.4.0.7938, Data-Shapes 2021.2.94, Clockwork for Dynamo 2.x 2.4.0, archi-lab.net 2022.210.2419

all = Orchid.RevitProject.Views.View.All()
code_block = CodeBlock { "Subclasificacion"; }
getParameterValueByName = Element.GetParameterValueByName(element=all, parameterName=code_block)
code_block_2 = CodeBlock { "02_MA"; }
eq = getParameterValueByName == code_block_2
filterByBoolMask = List.FilterByBoolMask(list=all, mask=eq)
name = Element.Name(element=filterByBoolMask.in)
isEmpty = List.IsEmpty(list=name)
code_block_3 = CodeBlock { "Grids"; }
byName = Category.ByName(name=code_block_3)
all_elements_of_category = ElementsOfCategory(Category=byName)
name_2 = Element.Name(element=all_elements_of_category)
groupByKey = List.GroupByKey(list=all_elements_of_category, keys=name_2)
code_block_4 = CodeBlock { 0; }
getItemAtIndex = List.GetItemAtIndex(list=groupByKey.groups@L2, index=code_block_4)
code_block_5 = CodeBlock { "_EJE_"; }
name_3 = Element.Name(element=getItemAtIndex)
add = code_block_5 + name_3
contains = String.Contains(str=name@L2, searchFor=add@L1, lacing=Longest)
isEmpty_2 = List.IsEmpty(list=contains)
anyTrue = Orchid.Common.List.AnyTrue(list=contains)
if_ = If(test=isEmpty_2, true=contains, false=anyTrue)
anyTrue_2 = Orchid.Common.List.AnyTrue(list=if_)
filterByBoolMask_2 = List.FilterByBoolMask(list=getItemAtIndex, mask=anyTrue_2)
code_block_6 = CodeBlock { null; }
replaceEmptyLists = Custom[List.ReplaceEmptyLists](seq=filterByBoolMask_2.out, Replacement=code_block_6)  # package Clockwork for Dynamo 2.x; Replaces all empty lists within a given list with a substitute
if_2 = If(test=isEmpty, true=getItemAtIndex, false=replaceEmptyLists)
name_4 = Custom[Element.Name+](element=if_2)  # package Clockwork for Dynamo 2.x; Gets an element's name. Unlike the OOTB node, this node should work for *all* Revit elements that have names and will also return the localized names of system parameters, parameter groups, display unit types, parameter types, unit symbol types, unit types and ForgeTypeIds.
code_block_7 = CodeBlock(nomEje=name_4) { "ELEVACION EJE "+nomEje; }
code_block_8 = CodeBlock { 440; }
boolean = BoolSelector(true)
boolean_2 = BoolSelector(true)
listview_data = Custom[Listview Data](Keys=code_block_7, Values=if_2, Height_optionnal=code_block_8, ShowElementCount_optionnal=boolean, ShowId_optionnal=boolean_2)  # package Data-Shapes; Create data for ListView input in UI.MultiInputForm ++ . Check out www.data-shapes.net for more infos.
code_block_9 = CodeBlock { "Escala"; }
code_block_10 = CodeBlock()
# ---------- code_block_10.designscript (6 lines) ----------
[
"1:50",
"1:75",
"1:100",
"1:125"
];
# ----------------------------------------
code_block_11 = CodeBlock { ":"; }
split = String.Split(str=code_block_10, separator0=code_block_11)
code_block_12 = CodeBlock { 1; }
getItemAtIndex_2 = List.GetItemAtIndex(list=split@L2, index=code_block_12)
toNumber = String.ToNumber(str=getItemAtIndex_2)
code_block_13 = CodeBlock { 0; false; }
dropdown_data = Custom[DropDown Data](InputName=code_block_9, Keys=code_block_10, Values=toNumber, DefaultValueIndex=code_block_13.out0, Sorted_optional=code_block_13.out1)  # package Data-Shapes; Create data for DropDown input in UI.MultiInputForm ++ . Check out www.data-shapes.net for more infos.
list_create = List.Create(item0=listview_data, item1=dropdown_data)  # frozen
isEmpty_3 = List.IsEmpty(list=if_2)
code_block_14 = CodeBlock { false; true; }
if_3 = If(test=isEmpty_3, true=code_block_14.out0, false=code_block_14.out1)
code_block_15 = CodeBlock { "Elevación por Eje"; }
code_block_16 = CodeBlock()
# ---------- code_block_16.designscript (9 lines) ----------
//buttonText
"INICIAR";
//buttonCancel
"CANCELAR";
//maxHeight

//width
440;
//label
# ----------------------------------------
code_block_17 = CodeBlock { "(Categoria MA)"; }
code_block_18 = CodeBlock { "Grids"; }
byName_2 = Category.ByName(name=code_block_18)
all_elements_of_category_2 = ElementsOfCategory(Category=byName_2)
code_block_19 = CodeBlock(g=all_elements_of_category_2) { "ELEVACIÓN EJE "+Revit.Elements.Element.Name(g); }
code_block_20 = CodeBlock { "Building Section (02_MA)"; }
byName_3 = Orchid.RevitProject.Views.ViewType.ByName(name=code_block_20)
byType = Orchid.RevitProject.Views.View.ByType(viewType=byName_3)
code_block_21 = CodeBlock { "Title on Sheet"; }
getParameterValueByName_2 = Element.GetParameterValueByName(element=byType, parameterName=code_block_21)
eq_2 = code_block_19 == getParameterValueByName_2
filterByBoolMask_3 = List.FilterByBoolMask(list=all_elements_of_category_2, mask=eq_2)
code_block_22 = CodeBlock(g=filterByBoolMask_3.out) { "ELEVACIÓN EJE "+Revit.Elements.Element.Name(g); }
code_block_23 = CodeBlock()
# ---------- code_block_23.designscript (8 lines) ----------
//heigth
440;
//elemCount
true;
//sort

//id
false;
# ----------------------------------------
listview_data_2 = Custom[Listview Data](Keys=code_block_22, Values=filterByBoolMask_3.out, Height_optionnal=code_block_23.out0, ShowElementCount_optionnal=code_block_23.out1, ShowId_optionnal=code_block_23.out2)
code_block_24 = CodeBlock { "Escala:"; }
code_block_25 = CodeBlock()  # same code as code_block_10
code_block_26 = CodeBlock { ":"; }
split_2 = String.Split(str=code_block_25, separator0=code_block_26)
code_block_27 = CodeBlock { 1; }
getItemAtIndex_3 = List.GetItemAtIndex(list=split_2@L2, index=code_block_27)
toNumber_2 = String.ToNumber(str=getItemAtIndex_3)
code_block_28 = CodeBlock { 0; false; }
dropdown_data_2 = Custom[DropDown Data](InputName=code_block_24, Keys=code_block_25, Values=toNumber_2, DefaultValueIndex=code_block_28.out0, Sorted_optional=code_block_28.out1)
list_create_2 = List.Create(item0=listview_data_2, item1=dropdown_data_2)
inputgroup_data = Custom[InputGroup Data](GroupTitle=code_block_17, Inputs=list_create_2)  # package Data-Shapes; Creates a group of inputs for UI.MultipleInputForm ++ . Check out www.data-shapes.net for more infos !
boolean_3 = BoolSelector(true)
multipleinputform = Custom[MultipleInputForm ++](Description_optional=code_block_15, ButtonText_optional=code_block_16.out0, Inputs=inputgroup_data, Toggle=boolean_3, CancelButtonText_optional=code_block_16.out1, Width_optional=code_block_16.out2)  # package Data-Shapes; Create a form with multiple inputs. see www.data-shapes.net for tutorials and infos!
code_block_29 = CodeBlock(x=multipleinputform.User_Inputs)
# ---------- code_block_29.designscript (13 lines) ----------
x;

[Imperative]
{
	if(x == null)
	{
		return = [[],[]];
	}
	else
	{
		return = x;
	}
};
# ----------------------------------------
code_block_30 = CodeBlock(l=code_block_29.out1) { l[0]; }
curve = Grid.Curve(grid=code_block_30)
direction = Line.Direction(line=curve)
normalized = Vector.Normalized(vector=direction)
code_block_31 = CodeBlock(p=normalized) { p.X; }
code_block_32 = CodeBlock { 2; }
round = Math.Round(number=code_block_31, digits=code_block_32)
code_block_33 = CodeBlock { 0; }
le = round <= code_block_33
reverse = Curve.Reverse(curve=curve)
scopeIf = Custom[ScopeIf+](test=le, True=reverse, False=curve, lacing=Shortest)  # package Clockwork for Dynamo 2.x; A (hopefully) more robust implementation of ScopeIf. Tests a single boolean and returns a value accordingly.
direction_2 = Line.Direction(line=scopeIf)
normalized_2 = Vector.Normalized(vector=direction_2)
code_block_34 = CodeBlock(p=normalized_2) { p.X; }
code_block_35 = CodeBlock { 2; }
round_2 = Math.Round(number=code_block_34, digits=code_block_35)
code_block_36 = CodeBlock { 0; }
eq_3 = round_2 == code_block_36
code_block_37 = CodeBlock(p=normalized_2) { p.Y; }
code_block_38 = CodeBlock { 2; }
round_3 = Math.Round(number=code_block_37, digits=code_block_38)
code_block_39 = CodeBlock { -1; }
eq_4 = round_3 == code_block_39
and_ = eq_3 && eq_4
reverse_2 = Curve.Reverse(curve=scopeIf)
scopeIf_2 = Custom[ScopeIf+](test=and_, True=scopeIf, False=reverse_2, lacing=Shortest)
ZAxis = Vector.ZAxis()
code_block_40 = CodeBlock { "Levels"; }
byName_4 = Category.ByName(name=code_block_40)
all_elements_of_category_3 = ElementsOfCategory(Category=byName_4)
elevation = Level.Elevation(level=all_elements_of_category_3)
minimumItem = List.MinimumItem(list=elevation)
code_block_41 = CodeBlock { -3000; }
add_2 = minimumItem + code_block_41
translate = Geometry.Translate(geometry=scopeIf_2, direction=ZAxis, distance=add_2, lacing=Longest)
code_block_42 = CodeBlock { "Building Section (02_MA)"; }
byName_5 = Orchid.RevitProject.Views.ViewType.ByName(name=code_block_42)
code_block_43 = CodeBlock { "Levels"; }
byName_6 = Category.ByName(name=code_block_43)
all_elements_of_category_4 = ElementsOfCategory(Category=byName_6)
elevation_2 = Level.Elevation(level=all_elements_of_category_4)
maximumItem = List.MaximumItem(list=elevation_2)
code_block_44 = CodeBlock { 7000; }
add_3 = maximumItem + code_block_44
code_block_45 = CodeBlock(h=add_3)
# ---------- code_block_45.designscript (6 lines) ----------
//height
h;
//offset
300;
//depth
300;
# ----------------------------------------
byLine = Custom[ViewSection.ByLine](Curves=translate, ViewFamilyType=byName_5, ViewSectionHeight=code_block_45.h, OffsetFromLine=code_block_45.out1, Depth=code_block_45.out2)  # package Data-Shapes; Create ViewSections in current document from DS Lines.
code_block_46 = CodeBlock(g=code_block_30) { "View Name"; "MA_ELEVACION EJE "+Revit.Elements.Element.Name(g); }
setParameterByName = Element.SetParameterByName(element=byLine, parameterName=code_block_46.out0, value=code_block_46.out1, lacing=Longest)
code_block_47 = CodeBlock(g=code_block_30) { "Title on Sheet"; "ELEVACIÓN EJE "+Revit.Elements.Element.Name(g); }
setParameterByName_2 = Element.SetParameterByName(element=setParameterByName, parameterName=code_block_47.out0, value=code_block_47.out1, lacing=Longest)
code_block_48 = CodeBlock(l=code_block_29.out1) { l[1]; }
setScale = View.SetScale(view=setParameterByName_2, scale=code_block_48, lacing=Longest)
code_block_49 = CodeBlock()
# ---------- code_block_49.designscript (5 lines) ----------
[
"Crop View",
"Crop Region Visible"
];
[0,0];
# ----------------------------------------
setParameterByName_3 = Element.SetParameterByName(element=setScale@L1, parameterName=code_block_49.out0@L2, value=code_block_49.out1@L2, lacing=Longest)
flatten = List.Flatten(list=setParameterByName_3)
uniqueItems = List.UniqueItems(list=flatten)
all_elements_in_view_s = Custom[All Elements In View(s)](Views=uniqueItems)  # package Data-Shapes; Retrieves all visible element in a view or a set of views
code_block_50 = CodeBlock { "View Name"; }
exists = Orchid.RevitProject.Parameters.Parameter.Exists(parameterName=code_block_50, element=all_elements_in_view_s)
filterByBoolMask_4 = List.FilterByBoolMask(list=all_elements_in_view_s, mask=exists)
code_block_51 = CodeBlock { "Type"; }
getParameterValueByName_3 = Element.GetParameterValueByName(element=filterByBoolMask_4.in, parameterName=code_block_51)
name_5 = Orchid.RevitProject.Elements.ElementType.Name(elementType=getParameterValueByName_3)
code_block_52 = CodeBlock { "Building Section (02_MA)"; }
eq_5 = name_5 == code_block_52
filterByBoolMask_5 = List.FilterByBoolMask(list=filterByBoolMask_4.in, mask=eq_5)
hideElements = archilab.Revit.Views.Views.HideElements(view=uniqueItems, elements=filterByBoolMask_5.in)
